# Grasshopper definition perlin_maze.gh (Grasshopper 1.0.7)
# plug-ins: Noise 4D, Parakeet, Shortest Walk in Gh, Kangaroo2 Components

maze_seed = Slider(18, range=0..100)
start = Slider(1227, range=0..3000)
radius_of_tube = Slider(1, range=0..10)
radius = Slider(35, range=1..50)
u_count = Slider(17, range=1..30)
v_count = Slider(22, range=1..30)
perlin_time = Slider(4.77, range=0..10)
perlin_scale = Slider(6, range=0..10)
point = Point(Point(0, 0, 6.729852585))
ucount = GetNumber(u_count, AtLeast=1, AtMost=1, Maximum=1.797693135e+308, Minimum=-1.797693135e+308)
seed = GetNumber(maze_seed, AtLeast=1, AtMost=1, Maximum=1.797693135e+308, Minimum=-1.797693135e+308)
start_2 = GetNumber(start, AtLeast=1, AtMost=10000, Maximum=1.797693135e+308, Minimum=-1.797693135e+308)
tube = GetNumber(radius_of_tube, AtLeast=1, AtMost=1, Maximum=1.797693135e+308, Minimum=-1.797693135e+308)
number_slider = Slider(165, range=0..200)
radius_2 = GetNumber(radius, AtLeast=1, AtMost=1, Maximum=1.797693135e+308, Minimum=-1.797693135e+308)
vcount = GetNumber(v_count, AtLeast=1, AtMost=1, Maximum=1.797693135e+308, Minimum=-1.797693135e+308)
time = GetNumber(perlin_time, AtLeast=1, AtMost=1, Maximum=1.797693135e+308, Minimum=-1.797693135e+308)
scale = GetNumber(perlin_scale, AtLeast=1, AtMost=1, Maximum=1.797693135e+308, Minimum=-1.797693135e+308)
mesh_sphere = MeshSphere(Base=point, Radius=radius_2, UCount=ucount, VCount=vcount)
division = Division(A=scale, B=number_slider)
subtraction = Subtraction(A=u_count, B=number_slider)
number_slider_2 = Slider(100, range=0..100)
absolute = Absolute(Value=subtraction)
deconstruct_mesh = DeconstructMesh(Mesh=mesh_sphere)  # -> Vertices, Faces, Colours, Normals
division_2 = Division(A=absolute, B=number_slider_2)
division_3 = Division(A=radius_2, B=number_slider_2)
perlinnoise = PerlinNoise(Values=deconstruct_mesh.Vertices, Time=time, Scale=division)
multiplication = Multiplication(A=deconstruct_mesh.Normals, B=perlinnoise)
division_4 = Division(A=tube, B=Slider(20, range=0..100))
multiplication_2 = Multiplication(A=Slider(15, range=0..100), B=multiplication)
colour = Colour(deconstruct_mesh.Normals)
addition = Addition(A=division_2, B=division_3, C=division_4)
move = Move(Geometry=deconstruct_mesh.Vertices, Motion=multiplication_2)  # -> Geometry, Transform
division_5 = Division(A=addition, B=Slider(2, range=0..10))
construct_mesh = ConstructMesh(Vertices=move.Geometry, Faces=deconstruct_mesh.Faces, Colours=colour)
maze = Maze(Mesh=construct_mesh, Seed=seed)
join_curves = JoinCurves(Curves=maze, Preserve=False)
explode = Explode(Curve=join_curves, Recursive=True)  # -> flatten(Segments), flatten(Vertices)
curve = Curve(explode.Segments)
boolean_toggle = BooleanToggle(True)
sort_list = SortList(Keys=curve, ValuesValuesA=curve)  # -> Keys, ValuesValuesA
list_item = ListItem(List=sort_list.ValuesValuesA, Index=start_2, Wrap=boolean_toggle)
list_item_2 = ListItem(List=sort_list.ValuesValuesA, Index="1", Wrap=boolean_toggle)
end_points = EndPoints(Curve=list_item)  # -> Start, End
end_points_2 = EndPoints(Curve=list_item_2)  # -> Start, End
curvepoint = PointOnCurve(sort_list.ValuesValuesA, parameter=0.5)
line = Line(StartPoint=end_points_2.Start, EndPoint=end_points.End)
pt = ConstructPoint(XCoordinate=0, YCoordinate=0, ZCoordinate=0)
pull = PullPoint(Point=curvepoint, Geometry=pt, ClosestOnly=True)  # -> ClosestPoint, Distance
bnd = Bounds(Numbers=pull.Distance)
shortest_walk = ShortestWalk(Curves=explode.Segments, WantedPath=line)  # -> ShortestWalk, Succession, Direction, Length
remap = RemapNumbers(Value=pull.Distance, Source=bnd, Target=Domain(0, 1))  # -> Mapped, Clipped
explode_2 = Explode(Curve=shortest_walk.ShortestWalk, Recursive=True)  # -> Segments, Vertices
gradient = Gradient(
    LowerLimit=0,
    UpperLimit=1,
    Parameter=remap.Mapped,
    stops=[0.1: RGB(236, 27, 60), 0.2: RGB(210, 0, 118), 0.3: RGB(103, 0, 120), 0.4: RGB(39, 72, 161), 0.5: RGB(1, 192, 229), 0.6: RGB(18, 178, 90), 0.7: RGB(79, 186, 8), 0.8: RGB(220, 237, 32), 0.9: RGB(247, 159, 20), 1: RGB(243, 57, 0)])
cull_duplicates = CullDuplicates(Points=explode_2.Vertices, Tolerance=0.1, CullMode=3)  # -> Points, Indices, Valence
list_length = ListLength(List=cull_duplicates.Points)
integer_division = IntegerDivision(A=list_length, B=Slider(1.5, range=0..10))
subtraction_2 = Subtraction(A=list_length, B=integer_division)
multipipe = MultiPipe(
    Curves=shortest_walk.ShortestWalk,
    NodeSize=division_5,
    EndOffset=1,
    StrutSize=Slider(0.412, range=0..2),
    Segment=0,
    KinkAngle=division_5,
    CubeFit=0,
    Caps=Slider(1, range=0..2))
absolute_2 = Absolute(Value=subtraction_2)
deconstruct_mesh_2 = DeconstructMesh(Mesh=multipipe)  # -> Vertices, Faces, Colours, Normals
mesh = Mesh(construct_mesh)
addition_2 = Addition(A=Slider(10, range=0..100), B=absolute_2)
length = Length(Curve=join_curves)
bnd_2 = Bounds(Numbers=deconstruct_mesh_2.Vertices)
random_reduce = RandomReduce(List=cull_duplicates.Points, Reduction=addition_2, Seed=seed)
distance = Distance(PointA=point, PointB=random_reduce)
remap_2 = RemapNumbers(Value=deconstruct_mesh_2.Vertices, Source=bnd_2, Target=Domain(0, 1))  # -> Mapped, Clipped
mass_addition = MassAddition(Input=length)  # -> Result, PartialResults
gradient_2 = Gradient(
    LowerLimit=0,
    UpperLimit=1,
    Parameter=remap_2.Mapped,
    stops=[0: RGB(234, 38, 0), 0.25: RGB(234, 126, 0), 0.5: RGB(254, 244, 84), 0.75: RGB(173, 203, 249), 1: RGB(75, 107, 169)])
division_6 = Division(A=distance, B=Slider(3, range=0..10))
scale_2 = Scale(Geometry=mesh, Center=point, Factor=Slider(0.524, range=0..2))  # -> Geometry, Transform
sphere = Sphere(Base=random_reduce, Radius=Slider(0.75, range=0..1))
amplitude = Amplitude(Vector=random_reduce, Amplitude=division_6)
medges = MeshEdges(Mesh=scale_2.Geometry)  # -> NakedEdges, InteriorEdges, NonManifoldEdges
move_2 = Move(Geometry=sphere, Motion=amplitude)  # -> Geometry, Transform
construct_mesh_2 = ConstructMesh(Vertices=deconstruct_mesh_2.Vertices, Faces=deconstruct_mesh_2.Faces, Colours=gradient_2)
area = Area(Geometry=move_2.Geometry)  # -> Area, Centroid
join = JoinCurves(Curves=medges.InteriorEdges, Preserve=False)
point_2 = Point(random_reduce)
point_3 = Point(area.Centroid)
distance_2 = Distance(PointA=point, PointB=area.Centroid)
sort_list_2 = SortList(Keys=point_3, ValuesValuesA=point_3)  # -> Keys, ValuesValuesA
sort_list_3 = SortList(Keys=point_2, ValuesValuesA=point_2)  # -> Keys, ValuesValuesA
division_7 = Division(A=distance_2, B=Slider(20, range=0..100))
scale_3 = Scale(Geometry=move_2.Geometry, Center=area.Centroid, Factor=division_7)  # -> flatten(Geometry), Transform
merge = Merge(Data1=sort_list_3.ValuesValuesA, Data2=sort_list_2.ValuesValuesA)
proximity_3d = Proximity3D(Points=merge, Group=Slider(1, range=0..10))  # -> flatten(Links), Topology
join_curves_2 = JoinCurves(Curves=proximity_3d.Links, Preserve=Toggle(False))
mesh_colours = MeshColours(Mesh=scale_3.Geometry, Colours=ColourSwatch(SwatchColor=RGB(58, 186, 163)))
entwine = Entwine(Branch00=scale_2.Geometry, Branch01=construct_mesh_2, Branch02=mesh_colours, FlattenInputs=True)
c_script = CSharpScript(crv=sort_list.ValuesValuesA, color=gradient)  # -> out, A; inputs crv: Curve, color: Color
# ---------- c_script: C# ----------
    var c = color.R + "," + color.G + "," + color.B;
    crv.SetUserString("color", c);
    A = crv;
# ---------- end c_script ----------
entwine_2 = Entwine(Branch00=join_curves_2, Branch01=c_script.A, FlattenInputs=True)  # -> flatten(Result)

# ---- group: RH_OUT:mesh
mesh_2 = Mesh(flatten(entwine))

# ----
curve_2 = Curve(shortest_walk.ShortestWalk)  # disabled

# ---- group: RH_OUT:length
data = Data(shortest_walk.Length)

# ---- group: RH_OUT:edges
curve_3 = Curve(entwine_2)

# ---- group: RH_OUT:curve
curve_4 = Curve(join)

# ---- group: RH_OUT:len
data_2 = Data(mass_addition.Result)
